# Dynamo custom node LunchBox Wall Element Collector cn.dyf "LunchBox Wall Element Collector" (Dynamo 0.8.0.950)
# category: LunchBox.Revit.Elements
# Collects wall elements from the Revit document.

Wall_Types = Input()
Parameter_Names = Input()
python_script = Python(IN[0]=Wall_Types, IN[1]=Parameter_Names)
# ---------- python_script.python (106 lines) ----------
#Copyright(c) 2014, Nathan Miller
# The Proving Ground, http://theprovingground.org

import clr

# Import RevitAPI
clr.AddReference("RevitAPI")
import Autodesk
from Autodesk.Revit.DB import *

# Import DocumentManager and TransactionManager
clr.AddReference("RevitServices")
import RevitServices
from RevitServices.Persistence import DocumentManager
from RevitServices.Transactions import TransactionManager

# Import ToDSType(bool) extension method
clr.AddReference("RevitNodes")
import Revit
clr.ImportExtensions(Revit.Elements)

#The input to this node will be stored in the IN[0] variable.

def getpara(para):
	ptype=para.StorageType
	if ptype==StorageType.String:
		paravalue=para.AsString()
	else:
		paravalue=para.AsValueString()	
	return paravalue
	
doc =  DocumentManager.Instance.CurrentDBDocument
app =  DocumentManager.Instance.CurrentUIApplication.Application


walltypes = UnwrapElement(IN[0])
paranames=IN[1]

typeslist=[]
output = []
walls = []
locations = []
elementids = []
uniqueids = []
paraset=[]
flag=0

if walltypes is None:
	pass
else:
	for item in walltypes:
		typeslist.append(item.Id)

if paranames is None:
	flag=0
else:
	flag=1

if flag:
	for i in range(len(paranames)):
		paraset.append([])
		
collector = FilteredElementCollector(doc)
collector.OfCategory(BuiltInCategory.OST_Walls)
collector.OfClass(Wall)

famtypeitr = collector.GetElementIdIterator()
famtypeitr.Reset()

for item in famtypeitr:
	inst = doc.GetElement(item)
	
	if walltypes is None:
		loc = Revit.GeometryConversion.RevitToProtoCurve.ToProtoType(inst.Location.Curve, True )
		walls.append(inst)
		if flag:
			for i in range(len(paranames)):
				paraset[i].append(getpara(inst.Parameter[paranames[i]]))
				
		locations.append(loc)
		elementids.append(inst.Id.ToString())
		uniqueids.append(inst.UniqueId)    
	
	elif inst.WallType.Id in typeslist:
		loc = Revit.GeometryConversion.RevitToProtoCurve.ToProtoType(inst.Location.Curve, True )
		wall = inst
		elementid = inst.Id.ToString()
		uniqueid = inst.UniqueId
		if flag:
			for i in range(len(paranames)):
				paraset[i].append(getpara(inst.Parameter[paranames[i]]))
		walls.append(wall)
		locations.append(loc)
		elementids.append(elementid)
		uniqueids.append(uniqueid)

	
output.append(walls)
output.append(locations)
output.append(elementids)
output.append(uniqueids)
if flag:
	output.append(paraset)	
        
#Assign your output to the OUT variable
OUT = output
# ----------------------------------------
code_block = CodeBlock { 0; 1; 2; 3; 4; }
getItemAtIndex = List.GetItemAtIndex(list=python_script, index=code_block.out0)
Element = Output(getItemAtIndex)
solids = Element.Solids(getItemAtIndex, lacing=Longest)
Solid = Output(solids)
getItemAtIndex_2 = List.GetItemAtIndex(list=python_script, index=code_block.out1)
Location_Curve = Output(getItemAtIndex_2)
getItemAtIndex_3 = List.GetItemAtIndex(list=python_script, index=code_block.out2)
ElementID = Output(getItemAtIndex_3)
getItemAtIndex_4 = List.GetItemAtIndex(list=python_script, index=code_block.out3)
Unique_ID = Output(getItemAtIndex_4)
getItemAtIndex_5 = List.GetItemAtIndex(list=python_script, index=code_block.out4)
Parameters = Output(getItemAtIndex_5)
