# Dynamo custom node Get Parameters from Elements.dyf (Dynamo 0.8.0.950)
# category: DynamoChina
# Get Parameters from Elements

Elements = Input()
Parameter_Names = Input()
code_block = CodeBlock(a=Parameter_Names) { {a,{}}; }
flatten = Flatten(code_block)
python_script = Python(IN[0]=Elements, IN[1]=flatten)
# ---------- python_script.python (69 lines) ----------
#Copyright (c) 2015, zhangzbxyz
#Dynamo中文社区 http://dynamochina.com

import clr

clr.AddReference("RevitAPI")
import Autodesk
from Autodesk.Revit.DB import *

clr.AddReference("RevitServices")
import RevitServices
from RevitServices.Persistence import DocumentManager

clr.AddReference("RevitNodes")
import Revit

clr.ImportExtensions(Revit.Elements)

def getparaval(para):
	ptype=para.StorageType
	if ptype==StorageType.String:
		paravalue=para.AsString()
	else:
		paravalue=para.AsValueString()	
	return paravalue

instlist = []
paranames=IN[1]

try:
	for item in IN[0]:
		instlist.append(UnwrapElement(item))
except:
	instlist.append(UnwrapElement(IN[0]))
	
doc = DocumentManager.Instance.CurrentDBDocument
output = []
famsyms = []
elementids = []
paraset = []
flag0= 0 if len(paranames)==0 else 1

if flag0:
	for i in range(len(paranames)):
		paraset.append([])

for inst in instlist:
	famsym=doc.GetElement(inst.GetTypeId())
	for i in range(len(paranames)):
		instpara= inst.Parameter[paranames[i]]
		fampara=famsym.Parameter[paranames[i]]
		try:
			para=getparaval(instpara)
		except:
			try:
				para=getparaval(fampara)
			except:
				para="no parameter"
		paraset[i].append(para)
			
	famsyms.append(famsym)
	elementids.append(inst.Id.ToString())

output.append(famsyms)
output.append(elementids)
if flag0:
	output.append(paraset)
        
OUT = output
# ----------------------------------------
code_block_2 = CodeBlock(list=python_script) { list[0]; list[1]; list[2]; }
FamilySymbol = Output(code_block_2.out0)
Parameters = Output(code_block_2.out2)
ElementID = Output(code_block_2.out1)
