# Dynamo graph element in room.dyn (Dynamo 0.8.1.1823)

select_model_elements = DSModelElementsSelection()
categories = Categories("Rooms")
all_elements_of_category = ElementsOfCategory(categories)
python_script = Python(IN[0]=select_model_elements, IN[1]=all_elements_of_category)
# ---------- python_script.python (46 lines) ----------
#Copyright (c) 2015, zhangzbxyz
#Dynamo中文社区 http://dynamochina.com

import sys
import clr
clr.AddReference('ProtoGeometry')
from Autodesk.DesignScript.Geometry import *
# Import ToDSType(bool) extension method
clr.AddReference("RevitNodes")
import Revit
clr.ImportExtensions(Revit.Elements)
# Import geometry conversion extension methods
clr.ImportExtensions(Revit.GeometryConversion)
# Import DocumentManager and TransactionManager

from System.Collections.Generic import *
# Import RevitAPI
clr.AddReference("RevitAPI")
import Autodesk
from Autodesk.Revit.DB import *

elements=[]
rooms=[]
roomlist=[]

rooms=UnwrapElement(IN[1])

try:
	for item in IN[0]:
		elements.append(UnwrapElement(item))
except:
	elements.append(UnwrapElement(IN[0]))


for ele in elements:
	point= ele.Location.Point
	flag=0
	for room in rooms:
		if room.IsPointInRoom(point):
			#fmly=family.GetType().Name
			roomlist.append(room.Id.ToString())
			flag=1
	if flag==0:
		roomlist.append(0)

OUT=roomlist
# ----------------------------------------
